% Simulink data dictionary controllerParams.sldd

guidanceParams = Simulink.Parameter(struct(phiCmd_rad=0, thetaCmd_rad=0, psiCmd_rad=0))

innerLoopParams = Simulink.Parameter(struct(
  upRateLimitPitchYaw_dps=180,
  loRateLimitPitchYaw_dps=-180,
  upLimitPitchYaw_deg=45,
  loLimitPitchYaw_deg=-45,
  upRateLimitRoll_dps=90,
  loRateLimitRoll_dps=-90,
  upLimitRoll_deg=5,
  loLimitRoll_deg=-5,
  fbkGainBreakpoints_Pa=[0 30000 75000],
  fbkGainPitchYawP_na=[150 125 100],
  fbkGainPitchYawI_na=[1500 2250 3000],
  fbkGainPitchYawD_na=[0 0 0],
  fbkGainPitchYawN_na=[1 1 1],
  fbkGainRollP_na=[0.7 0.9 1],
  fbkGainRollI_na=[0.7 0.9 1],
  fbkGainRollD_na=[0 0 0],
  fbkGainRollN_na=[1 1 1]))

outerLoopParams = Simulink.Parameter(struct(
  upRateLimitPitchYawRate_rps2=0.5,
  loRateLimitPitchYawRate_rps2=-0.5,
  upLimitPitchYawRate_rps=0.4,
  loLimitPitchYawRate_rps=-0.4,
  pitchYawGains=[2 0.4 0 1],
  upRateLimitRollRate_rps2=5,
  loRateLimitRollRate_rps2=-5,
  upLimitRollRate_rps=2,
  loLimitRollRate_rps=-2,
  rollGains=[1 2 0 100]))